# Grasshopper definition JSON_visualisation.gh (Grasshopper 1.0.7)

path = FilePath("E:\WORKS AND PROJECTS\+ 2020-2022 Technion\+ Research\Simulations\LadyBugTools SDK\outputs\01\model_with_default_settings.hbjson")
trigger = Trigger(Interval=1000, TimerInterval=1000, Target=loadobjects)
loadobjects = HBLoadObjects(hb_file=path, load=Toggle(True))  # -> report, hb_objs; plug-in component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
list = ValueList({"BeerSheva": "https://www.energyplus.net/weather-download/europe_wmo_region_6/ISR//ISR_Beer.Sheva.401900_MSI/all", "Tel Aviv - Bet Dagan": "https://www.energyplus.net/weather-download/europe_wmo_region_6/ISR//ISR_Tel.Aviv-Bet.Dagan.401790_MSI/all", "Tel Aviv - Ben Gurion": "http://climate.onebuilding.org/WMO_Region_6_Europe/ISR_Israel/TA_Tel-Aviv/ISR_TA_Tel.Aviv-Ben.Gurion.Intl.AP.401790_IMS.zip", "Eilat": "https://www.energyplus.net/weather-download/europe_wmo_region_6/ISR//ISR_Eilat.401990_MSI/all", "Jerusalem": "https://www.energyplus.net/weather-download/europe_wmo_region_6/ISR//ISR_Jerusalem.401840_IWEC/all", "Jerusalem - Atarot": "https://www.energyplus.net/weather-download/europe_wmo_region_6/ISR//ISR_Jerusalem-Atarot.AP.401840_MSI/all", "None": "", "Ashalim": "C:\IsraelWeatherFiles\ISR_Ashalim_MN6.epw", "Haifa_WhiteBoxTech": "C:\IsraelWeatherFiles\ISR_HAIFA_401550_IW2.EPW", "Haifa_Segoe": "C:\IsraelWeatherFiles\ISR_HaifaSego.epw", "Haifa_BatGalim": "C:\IsraelWeatherFiles\HaifaBatGalim-SPtMasterTable_552848_19790101_20110101_TMY3.epw", "Haifa_Technion": "C:\IsraelWeatherFiles\HaifaTechnion_SPtMasterTable_551698_19790101_20110101_TMY3.epw", "Natanya_Dura": "C:\IsraelWeatherFiles\Natanya-SPtMasterTable_550544_19790101_20110101_TMY3.epw"}, selected="BeerSheva")
roomenergyattr = HBRoomEnergyAttributes({"Program": "properties.energy.program_type.display_name", "Construction Set": "properties.energy.construction_set.display_name", "Is Conditioned": "properties.energy.is_conditioned", "People per Area [ppl/m2]": "properties.energy.people.people_per_area", "Area per Person [m2/ppl]": "properties.energy.people.area_per_person", "Lighting per Area [W/m2]": "properties.energy.lighting.watts_per_area"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}, selected="Program")
faceenergyattr = HBFaceEnergyAttributes({"Construction": "properties.energy.construction.display_name", "Materials": "properties.energy.construction.layers", "R-Value": "properties.energy.construction.r_value", "U-Value": "properties.energy.construction.u_value", "U-Factor": "properties.energy.construction.u_factor", "Solar Transmitance [Unshaded]": "properties.energy.construction.solar_transmittance", "Solar Reflectance [Outside]": "properties.energy.construction.outside_solar_reflectance", "Solar Reflectance [Inside]": "properties.energy.construction.inside_solar_reflectance", "Fraction Area Operable": "properties.energy.vent_opening.fraction_area_operable", "Fraction Height Operable": "properties.energy.vent_opening.fraction_height_operable", "Discharge Coefficient": "properties.energy.vent_opening.discharge_coefficient", "Cross Ventilation": "properties.energy.vent_opening.wind_cross_vent"}, selected="Construction")
faceattr = HBFaceAttributes({"Display Name": "display_name", "Simulation Name (Identifier)": "identifier", "Boundary Condition": "boundary_condition", "Has Parent": "has_parent", "Parent": "parent", "Area": "area", "Perimeter": "perimeter", "Face Type": "type", "Aperture Is Operable": "is_operable", "Door Is Glass": "is_glass"}, selected="Display Name")
deconstructmodel = HBDeconstructModel(model=loadobjects.hb_objs)  # -> rooms, faces, apertures, doors, shades; plug-in component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
downloadepw = LBDownloadWeather(weather_URL=list)  # -> epw_file, stat_file, ddy_file; plug-in component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
colorroomattr = HBColorRoomAttributes(rooms_model=flatten(loadobjects.hb_objs), attribute=roomenergyattr)  # -> mesh, legend, wire_frame, values, colors; plug-in component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
colorfaceattr = HBColorFaceAttributes(hb_objs=flatten(loadobjects.hb_objs), attribute=faceattr)  # -> mesh, legend, wire_frame, values, colors; plug-in component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
colorfaceattr_2 = HBColorFaceAttributes(hb_objs=flatten(loadobjects.hb_objs), attribute=faceenergyattr)  # -> mesh, legend, wire_frame, values, colors; plug-in component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
annualloads = HBAnnualLoads(
    rooms=deconstructmodel.rooms,
    shades=flatten(deconstructmodel.shades),
    epw_file=downloadepw.epw_file,
    cool_cop="3",
    heat_cop="3",
    run=Toggle(False))  # -> report, total_load, cooling, heating, lighting, equip, hot_water, balance; plug-in component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
xdata = LBDeconstructData(data=annualloads.cooling)  # -> header, values; plug-in component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
xdata_2 = LBDeconstructData(data=annualloads.lighting)  # -> header, values; plug-in component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
xdata_3 = LBDeconstructData(data=annualloads.heating)  # -> header, values; plug-in component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
ma = MassAddition(Input=annualloads.total_load)  # -> Result, PartialResults
ma_2 = MassAddition(Input=xdata.values)  # -> Result, PartialResults
eui = Panel(ma.Result)
ma_3 = MassAddition(Input=xdata_2.values)  # -> Result, PartialResults
ma_4 = MassAddition(Input=xdata_3.values)  # -> Result, PartialResults
ma_5 = MassAddition(Input=[ma_2.Result, ma_4.Result, ma_3.Result])  # -> Result, PartialResults
eui_equip = Panel(ma_5.Result)
